# Dynamo graph EC2_MUROS_CAP.dyn (Dynamo 4.1.1.5050)

file_path = Filename("C:\Users\TUF\Desktop\BIM MANAGEMENT\03_SEMESTRE\01_INTELIGENCIA ARTIFICIAL\03_ENTREGABLES\EC2\Muros.xlsx")
string = StringInput("Hoja1")
categories = Categories("OST_Walls")
all_elements_of_category = ElementsOfCategory(Category=categories)
python_script = Python(IN[0]=all_elements_of_category)  # PythonNet3
# ---------- python_script.python (69 lines) ----------
import clr

clr.AddReference('RevitServices')
from RevitServices.Persistence import DocumentManager

clr.AddReference('RevitAPI')
from Autodesk.Revit.DB import *

# Documento activo de Revit
doc = DocumentManager.Instance.CurrentDBDocument

# Elementos recibidos desde Dynamo
elementos = UnwrapElement(IN[0])

# Asegurar que la entrada sea una lista
if not isinstance(elementos, list):
    elementos = [elementos]

# Lista para almacenar los resultados
registros = []

for el in elementos:
    if el is None:
        continue

    # Obtener el ID del muro
    id_muro = el.Id.Value

    # Obtener el nombre del tipo de muro
    tipo = doc.GetElement(el.GetTypeId())
    nombre = tipo.Name if tipo else "Sin tipo"

    # Obtener el nivel base del muro
    parametro = el.get_Parameter(
        BuiltInParameter.WALL_BASE_CONSTRAINT
    )

    nivel = "Sin nivel"

    if parametro:
        nivel_id = parametro.AsElementId()
        nivel_elemento = doc.GetElement(nivel_id)

        if nivel_elemento:
            nivel = nivel_elemento.Name

    # Guardar la información
    registros.append({
        "Id": id_muro,
        "Nombre": nombre,
        "Nivel": nivel
    })

# Enviar resultados a Dynamo

valores_validos = ["Concrete 12", "Concrete 18", "Concrete 24"]
for r in registros:
    if r["Nombre"] is None or r["Nombre"] == "":
        r["Estado"] = "Falta parámetro"
    elif r["Nombre"] not in valores_validos:
        r["Estado"] = "Fuera de estándar"
    else:
        r["Estado"] = "OK"
        
encabezados = ["Id", "Nombre", "Nivel", "Estado"]
filas = [[r["Id"], r["Nombre"],
r["Nivel"], r["Estado"]]
for r in registros]
OUT = [encabezados] + filas
# ----------------------------------------
watch = Watch(python_script)
openXMLExportExcel = Data.OpenXMLExportExcel(filePath=file_path, sheetName=string, data=watch)
